# Dynamo graph Execute_createModels.dyn (Dynamo 2.12.0.5650)
# packages: archi-lab.net 2022.210.1022

rerunnodes = Python()  # CPython3; unwired: IN[0]
# ---------- rerunnodes.python (83 lines) ----------
###############################################################
# Import general packages.
import clr
import sys
import math
import System
import io
import os
import importlib

# Import Revit/Dynamo API related packages.
clr.AddReference('DynamoRevitDS')
import Dynamo
from System import Array
from System.Collections.Generic import *
clr.AddReference("RevitNodes")
import Revit
clr.ImportExtensions(Revit.Elements)
clr.ImportExtensions(Revit.GeometryConversion)
clr.AddReference("RevitServices")
import RevitServices
from RevitServices.Persistence import DocumentManager 
from RevitServices.Transactions import TransactionManager 
clr.AddReference("RevitAPI")
clr.AddReference('ProtoGeometry')
import Autodesk 
from Autodesk.DesignScript.Geometry import *
from Autodesk.DesignScript import *
from Autodesk.Revit.DB import *
from Autodesk.Revit.DB import Parameter
from Autodesk.Revit.DB.Architecture import *
from Autodesk.Revit.DB import IFailuresPreprocessor

# Import external python packages.
localapp = os.getenv(r'LOCALAPPDATA')
sys.path.append(os.path.join(localapp, r'python-3.8.3-embed-amd64\Lib\site-packages'))

# Import customized python packgaes.
sys.path.append(r'C:\dev\phd\jw\healing\src\godyn')

import healBasics
importlib.reload(healBasics)
import healChecks
importlib.reload(healChecks)
import healParameters
importlib.reload(healParameters)

###############################################################
doc = DocumentManager.Instance.CurrentDBDocument


###############################################################
# Temporary functions


###############################################################
# Prepare the input (of the Python Node)
element = IN[0]


##############################################################
# Prepare the output (of the Python Node)
out = []


###############################################################
# Start Transaction in Revit
TransactionManager.Instance.EnsureInTransaction(doc)


###############################################################
# Main part
healBasics.rerunNodes()


###############################################################
# End Transaction in Revit
TransactionManager.Instance.TransactionTaskDone()


###############################################################
# End
OUT = out
# ----------------------------------------

# group: model information
string = StringInput("C:\dev\phd\ModelHealer\ini\model")
directory_from_path = DirectoryObject(path=string)
string_2 = StringInput("ini_param.rvt")
getDirectoryContents = FileSystem.GetDirectoryContents(directory=directory_from_path, searchString=string_2)
file_from_path = FileObject(path=getDirectoryContents.files)

# group: create failure visualization .rvts
string_3 = StringInput("ini_param_visualization.rvt")
replace = String.Replace(string=getDirectoryContents.files, searchFor=string_2, replaceWith=string_3)
create_visualization = BoolSelector(true)
copyFile = FileSystem.CopyFile(file=file_from_path, destinationPath=replace, overwrite=create_visualization, lacing=Longest)

# group: create a simplified .rvt as variation skeleton.
string_4 = StringInput("ini_param_skeleton.rvt")
replace_2 = String.Replace(string=getDirectoryContents.files, searchFor=string_2, replaceWith=string_4)
create_skeleton = BoolSelector(true)
passThrough = Custom[PassThrough](passThrough=create_skeleton, waitFor=copyFile)  # package archi-lab.net; Ripped this off from Clockwork. Sorry Andy.
copyFile_2 = FileSystem.CopyFile(file=file_from_path, destinationPath=replace_2, overwrite=passThrough, lacing=Longest)
