# Dynamo graph Execute_visualizeSelection.dyn (Dynamo 2.12.0.5650)
# packages: Clockwork for Dynamo 2.x 2.3.0

rerunnodes = Python()  # CPython3; frozen; unwired: IN[0]
# ---------- rerunnodes.python (83 lines) ----------
###############################################################
# Import general packages.
import clr
import sys
import math
import System
import io
import os
import importlib

# Import Revit/Dynamo API related packages.
clr.AddReference('DynamoRevitDS')
import Dynamo
from System import Array
from System.Collections.Generic import *
clr.AddReference("RevitNodes")
import Revit
clr.ImportExtensions(Revit.Elements)
clr.ImportExtensions(Revit.GeometryConversion)
clr.AddReference("RevitServices")
import RevitServices
from RevitServices.Persistence import DocumentManager 
from RevitServices.Transactions import TransactionManager 
clr.AddReference("RevitAPI")
clr.AddReference('ProtoGeometry')
import Autodesk 
from Autodesk.DesignScript.Geometry import *
from Autodesk.DesignScript import *
from Autodesk.Revit.DB import *
from Autodesk.Revit.DB import Parameter
from Autodesk.Revit.DB.Architecture import *
from Autodesk.Revit.DB import IFailuresPreprocessor

# Import external python packages.
localapp = os.getenv(r'LOCALAPPDATA')
sys.path.append(os.path.join(localapp, r'python-3.8.3-embed-amd64\Lib\site-packages'))

# Import customized python packgaes.
sys.path.append(r'C:\dev\phd\jw\healing\src\godyn')

import healBasics
importlib.reload(healBasics)
import healChecks
importlib.reload(healChecks)
import healParameters
importlib.reload(healParameters)

###############################################################
doc = DocumentManager.Instance.CurrentDBDocument


###############################################################
# Temporary functions


###############################################################
# Prepare the input (of the Python Node)
element = IN[0]


##############################################################
# Prepare the output (of the Python Node)
out = []


###############################################################
# Start Transaction in Revit
TransactionManager.Instance.EnsureInTransaction(doc)


###############################################################
# Main part
healBasics.rerunNodes()


###############################################################
# End Transaction in Revit
TransactionManager.Instance.TransactionTaskDone()


###############################################################
# End
OUT = out
# ----------------------------------------

# group: Tune the graphics style.
current = Document.Current()
activeView = Document.ActiveView(document=current)
setGraphicsStyle = Python(IN[0]=activeView)  # CPython3
# ---------- setGraphicsStyle.python (83 lines) ----------
###############################################################
# Import general packages.
import clr
import sys
import math
import System
import io
import os
import importlib

# Import Revit/Dynamo API related packages.
clr.AddReference('DynamoRevitDS')
import Dynamo
from System import Array
from System.Collections.Generic import *
clr.AddReference("RevitNodes")
import Revit
clr.ImportExtensions(Revit.Elements)
clr.ImportExtensions(Revit.GeometryConversion)
clr.AddReference("RevitServices")
import RevitServices
from RevitServices.Persistence import DocumentManager 
from RevitServices.Transactions import TransactionManager 
clr.AddReference("RevitAPI")
clr.AddReference('ProtoGeometry')
import Autodesk 
from Autodesk.DesignScript.Geometry import *
from Autodesk.DesignScript import *
from Autodesk.Revit.DB import *
from Autodesk.Revit.DB import Parameter
from Autodesk.Revit.DB.Architecture import *
from Autodesk.Revit.DB import IFailuresPreprocessor

# Import external python packages.
localapp = os.getenv(r'LOCALAPPDATA')
sys.path.append(os.path.join(localapp, r'python-3.8.3-embed-amd64\Lib\site-packages'))

# Import customized python packgaes.
sys.path.append(r'C:\dev\phd\jw\healing\src\godyn')

import healBasics
importlib.reload(healBasics)
import healChecks
importlib.reload(healChecks)
import healParameters
importlib.reload(healParameters)
import healVisual
importlib.reload(healVisual)

###############################################################
doc = DocumentManager.Instance.CurrentDBDocument


###############################################################
# Temporary functions


###############################################################
# Prepare the input (of the Python Node)
elements = UnwrapElement(IN[0])

##############################################################
# Prepare the output (of the Python Node)
out = []

###############################################################
# Start Transaction in Revit
TransactionManager.Instance.EnsureInTransaction(doc)


###############################################################
# Main part
out = healVisual.setGraphicsStyle(elements)


###############################################################
# End Transaction in Revit
TransactionManager.Instance.TransactionTaskDone()


###############################################################
# End
OUT = out
# ----------------------------------------

# group: Viasulize/highlight the related building elements.
highlightSelection = Python()  # CPython3; frozen; unwired: IN[0]
# ---------- highlightSelection.python (83 lines) ----------
###############################################################
# Import general packages.
import clr
import sys
import math
import System
import io
import os
import importlib

# Import Revit/Dynamo API related packages.
clr.AddReference('DynamoRevitDS')
import Dynamo
from System import Array
from System.Collections.Generic import *
clr.AddReference("RevitNodes")
import Revit
clr.ImportExtensions(Revit.Elements)
clr.ImportExtensions(Revit.GeometryConversion)
clr.AddReference("RevitServices")
import RevitServices
from RevitServices.Persistence import DocumentManager 
from RevitServices.Transactions import TransactionManager 
clr.AddReference("RevitAPI")
clr.AddReference('ProtoGeometry')
import Autodesk 
from Autodesk.DesignScript.Geometry import *
from Autodesk.DesignScript import *
from Autodesk.Revit.DB import *
from Autodesk.Revit.DB import Parameter
from Autodesk.Revit.DB.Architecture import *
from Autodesk.Revit.DB import IFailuresPreprocessor

# Import external python packages.
localapp = os.getenv(r'LOCALAPPDATA')
sys.path.append(os.path.join(localapp, r'python-3.8.3-embed-amd64\Lib\site-packages'))

# Import customized python packgaes.
sys.path.append(r'C:\dev\phd\jw\healing\src\godyn')

import healBasics
importlib.reload(healBasics)
import healChecks
importlib.reload(healChecks)
import healParameters
importlib.reload(healParameters)
import healVisual
importlib.reload(healVisual)

###############################################################
doc = DocumentManager.Instance.CurrentDBDocument


###############################################################
# Temporary functions


###############################################################
# Prepare the input (of the Python Node)
elements = UnwrapElement(IN[0])

##############################################################
# Prepare the output (of the Python Node)
out = []

###############################################################
# Start Transaction in Revit
TransactionManager.Instance.EnsureInTransaction(doc)


###############################################################
# Main part
out = healVisual.highlightSelection(elements)


###############################################################
# End Transaction in Revit
TransactionManager.Instance.TransactionTaskDone()


###############################################################
# End
OUT = out
# ----------------------------------------
string = StringInput("C:\dev\phd\ModelHealer\ini\topo\res_ini_perrule_failureneighbor.csv")  # frozen
readCSV = Python(IN[0]=string)  # CPython3
# ---------- readCSV.python (84 lines) ----------
###############################################################
# Import general packages.
import clr
import sys
import math
import System
import io
import os
import importlib

# Import Revit/Dynamo API related packages.
clr.AddReference('DynamoRevitDS')
import Dynamo
from System import Array
from System.Collections.Generic import *
clr.AddReference("RevitNodes")
import Revit
clr.ImportExtensions(Revit.Elements)
clr.ImportExtensions(Revit.GeometryConversion)
clr.AddReference("RevitServices")
import RevitServices
from RevitServices.Persistence import DocumentManager 
from RevitServices.Transactions import TransactionManager 
clr.AddReference("RevitAPI")
clr.AddReference('ProtoGeometry')
import Autodesk 
from Autodesk.DesignScript.Geometry import *
from Autodesk.DesignScript import *
from Autodesk.Revit.DB import *
from Autodesk.Revit.DB import Parameter
from Autodesk.Revit.DB.Architecture import *
from Autodesk.Revit.DB import IFailuresPreprocessor

# Import external python packages.
localapp = os.getenv(r'LOCALAPPDATA')
sys.path.append(os.path.join(localapp, r'python-3.8.3-embed-amd64\Lib\site-packages'))

# Import customized python packgaes.
sys.path.append(r'C:\dev\phd\jw\healing\src\godyn')

import healBasics
importlib.reload(healBasics)
import healChecks
importlib.reload(healChecks)
import healParameters
importlib.reload(healParameters)
import healVisual
importlib.reload(healVisual)

###############################################################
doc = DocumentManager.Instance.CurrentDBDocument


###############################################################
# Temporary functions


###############################################################
# Prepare the input (of the Python Node)
csvPath = IN[0]


##############################################################
# Prepare the output (of the Python Node)
out = []


###############################################################
# Start Transaction in Revit
TransactionManager.Instance.EnsureInTransaction(doc)


###############################################################
# Main part
out = healBasics.readCSV(csvPath, skip_first_col=True, transpose=True, clear_list=True)

###############################################################
# End Transaction in Revit
TransactionManager.Instance.TransactionTaskDone()


###############################################################
# End
OUT = out
# ----------------------------------------

string_2 = StringInput("C:\dev\phd\ModelHealer\ini\topo\res_ini_perrule_failure.csv")
readCSV_2 = Python(IN[0]=string_2)  # CPython3; same code as readCSV
number = DoubleInput(0)
getItemAtIndex = List.GetItemAtIndex(list=readCSV_2@L2, index=number)
string_3 = StringInput("IBC1020_2")
indexOf = List.IndexOf(list=getItemAtIndex, element=string_3)
getItemAtIndex_2 = List.GetItemAtIndex(list=readCSV_2, index=indexOf)
removeItemAtIndex = List.RemoveItemAtIndex(list=getItemAtIndex_2, indices=number)
getElementsByIfcGUIDs = Python(IN[0]=removeItemAtIndex)  # CPython3
# ---------- getElementsByIfcGUIDs.python (84 lines) ----------
###############################################################
# Import general packages.
import clr
import sys
import math
import System
import io
import os
import importlib

# Import Revit/Dynamo API related packages.
clr.AddReference('DynamoRevitDS')
import Dynamo
from System import Array
from System.Collections.Generic import *
clr.AddReference("RevitNodes")
import Revit
clr.ImportExtensions(Revit.Elements)
clr.ImportExtensions(Revit.GeometryConversion)
clr.AddReference("RevitServices")
import RevitServices
from RevitServices.Persistence import DocumentManager 
from RevitServices.Transactions import TransactionManager 
clr.AddReference("RevitAPI")
clr.AddReference('ProtoGeometry')
import Autodesk 
from Autodesk.DesignScript.Geometry import *
from Autodesk.DesignScript import *
from Autodesk.Revit.DB import *
from Autodesk.Revit.DB import Parameter
from Autodesk.Revit.DB.Architecture import *
from Autodesk.Revit.DB import IFailuresPreprocessor

# Import external python packages.
localapp = os.getenv(r'LOCALAPPDATA')
sys.path.append(os.path.join(localapp, r'python-3.8.3-embed-amd64\Lib\site-packages'))

# Import customized python packgaes.
sys.path.append(r'C:\dev\phd\jw\healing\src\godyn')

import healBasics
importlib.reload(healBasics)
import healChecks
importlib.reload(healChecks)
import healParameters
importlib.reload(healParameters)
import healVisual
importlib.reload(healVisual)

###############################################################
doc = DocumentManager.Instance.CurrentDBDocument


###############################################################
# Temporary functions


###############################################################
# Prepare the input (of the Python Node)
element = IN[0]


##############################################################
# Prepare the output (of the Python Node)
out = []


###############################################################
# Start Transaction in Revit
TransactionManager.Instance.EnsureInTransaction(doc)


###############################################################
# Main part
out = healBasics.getElementsByIfcGUIDs(doc, element)

###############################################################
# End Transaction in Revit
TransactionManager.Instance.TransactionTaskDone()


###############################################################
# End
OUT = out
# ----------------------------------------
number_2 = DoubleInput(255)
byARGB = Color.ByARGB(red=number_2, green=number_2)
categories = Categories("OST_Views")
all_elements_of_category = ElementsOfCategory(Category=categories)
boolean = BoolSelector(false)
clean = List.Clean(list=all_elements_of_category, preserveIndices=boolean)
code_block = CodeBlock { "View Name"; }
getParameterValueByName = Element.GetParameterValueByName(element=clean, parameterName=code_block)
level = Custom[Element.Level](element=getElementsByIfcGUIDs)  # package Clockwork for Dynamo 2.x; Gets an element's level
name = Level.Name(level=level)
string_4 = StringInput("D_ue")
string_5 = StringInput("RES")
replace = String.Replace(string=name, searchFor=string_4, replaceWith=string_5)
string_6 = StringInput("_")
add = replace + string_6
add_2 = add + string_3
eq = getParameterValueByName == add_2@L1
filterByBoolMask = List.FilterByBoolMask(list=clean, mask=eq@L2)
flatten = List.Flatten(list=filterByBoolMask.in)
python_script = Python(IN[0]=getElementsByIfcGUIDs, IN[1]=byARGB, IN[2]=flatten)  # CPython3; frozen
# ---------- python_script.python (88 lines) ----------
###############################################################
# Import general packages.
import clr
import sys
import math
import System
import io
import os
import importlib

# Import Revit/Dynamo API related packages.
clr.AddReference('DynamoRevitDS')
import Dynamo
from System import Array
from System.Collections.Generic import *
clr.AddReference("RevitNodes")
import Revit
clr.ImportExtensions(Revit.Elements)
clr.ImportExtensions(Revit.GeometryConversion)
clr.AddReference("RevitServices")
import RevitServices
from RevitServices.Persistence import DocumentManager 
from RevitServices.Transactions import TransactionManager 
clr.AddReference("RevitAPI")
clr.AddReference('ProtoGeometry')
import Autodesk 
from Autodesk.DesignScript.Geometry import *
from Autodesk.DesignScript import *
from Autodesk.Revit.DB import *
from Autodesk.Revit.DB import Parameter
from Autodesk.Revit.DB.Architecture import *
from Autodesk.Revit.DB import IFailuresPreprocessor

# Import external python packages.
localapp = os.getenv(r'LOCALAPPDATA')
sys.path.append(os.path.join(localapp, r'python-3.8.3-embed-amd64\Lib\site-packages'))

# Import customized python packgaes.
sys.path.append(r'C:\dev\phd\jw\healing\src\godyn')

import healBasics
importlib.reload(healBasics)
import healChecks
importlib.reload(healChecks)
import healParameters
importlib.reload(healParameters)
import healVisual
importlib.reload(healVisual)


def ConvertColor(e):
	return Autodesk.Revit.DB.Color(e.Red, e.Green, e.Blue)

def OverrideColorPattern(e, c, f, view):
	gSettings = OverrideGraphicSettin
###############################################################
doc = DocumentManager.Instance.CurrentDBDocument


###############################################################
# Temporary functions


###############################################################
# Prepare the input (of the Python Node)
element = UnwrapElement(IN[0])
color = UnwrapElement(IN[1])
view = UnwrapElement(IN[2])

##############################################################
# Prepare the output (of the Python Node)
out = []


###############################################################
# Start Transaction in Revit
TransactionManager.Instance.EnsureInTransaction(doc)


###############################################################
# Main part
out = healVisual.overrideSpaceDisplay(element, color, view)

###############################################################
# End Transaction in Revit
TransactionManager.Instance.TransactionTaskDone()

OUT=out
# ----------------------------------------
