# Dynamo graph test.dyn (Dynamo 2.12.0.5650)

current = Document.Current()
activeView = Document.ActiveView(document=current)
string = StringInput("C:\dev\phd\ModelHealer\ini\model\test.png")
exportAsImage = View.ExportAsImage(view=activeView, path=string)
